vi "Filter Systems by Package.gviweb"   [LabVIEW NXG 4.0.0]
inputs:
  "configuration in": "Configuration.gtype"
  "package": string
  "error in": error
outputs:
  "systems": T1[]
  "error out": error
  "configuration out": "Configuration.gtype"
panel indicators:
  "id": string[]
types:
  "Client Handle.gtype" = u32
  "Configuration.gtype" = cluster{"Server URL": string, "Session": "Client Handle.gtype", "Raw Session Queue": Queue<"Client Handle.gtype">}
  T1 = cluster{"id": string, "alias": string, "state": string}
uses:
  NI::HTTP::POST Buffer.gvi
diagram:
  Property Node(instance in=$"configuration in") -> ("Session"=w1, "Server URL"=w2)
  Concatenate Strings(w2, "/nisysmgmt/v1/query-systems") -> w3
  w4 = "\\\")\",\n  \"projection\": \"new(id,alias,connected.data.state)\"\n}"
  Concatenate Strings("{  \n  \"filter\": \"packages.data.Keys.Contains(\\\"", $package, w4) -> w5
  call "POST Buffer.gvi"(client handle=w1, url=w3, buffer=w5, error in=$"error in") -> (body=w6, error out=w7)
  Unflatten From JSON(JSON string=w6, default null elements=TRUE, error in (no error)=w7, type and defaults=cluster{"data": T1[], "count": i32} {all zero or empty}) -> (error out=w8, value=w9)
  Property Node(instance in=w9) -> ("data"=w10)
  $systems <- w10
  $"configuration out" <- $"configuration in"
  for {
    w11 = each element of w10
    Property Node(instance in=w11) -> ("id"=w13)
    append w13 to w12
  }
  $id <- w12
  $"error out" <- w8
